# Grasshopper definition Final_GeometrySlice_ToolpathCreation.gh (Grasshopper 1.0.8)
# plug-ins: RhinoCodePluginGH, Robots, Bifocals

# ----
# no inputs
# input
# inputs present but
# likely no change.
# visual table
brep_worktable = Brep([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])
custom_preview = CustomPreview(Geometry=brep_worktable, Material=ColourSwatch(SwatchColor=RGB(227, 227, 227)))

# ---- group: layer height (mm)
layer_height = Slider(3, range=0..10)

# ---- group: print width (mm)
print_width = Slider(3, range=0..10)

# ---- group: Define polygon geometry
point = Point(Point(0, -443.4243923, 0.5243924708))
polygon = Polygon(Plane=point, Radius=Slider(50, range=0..100), Segments="3", FilletRadius=0)  # -> Polygon, Length

# ----
# additional board height
# added to get print at ok
# height on table.
number_slider = Slider(5, range=0..100)

# ----
# measurements taken
# for new tool coordinates
# of the clay extruder.
global_z = Slider(135, range=-200..200)
global_y = Slider(58, range=-200..200)
global_x = Slider(0, range=-200..200)

# ----
# print board height
number_slider_2 = Slider(18.85, range=0..100)

# ---- group: Polygon surface
brep = Brep(polygon.Polygon)

# ----
# 2. initialize robots plugin
robots_library = RobotsLibrary({"TUDelft-LAMA-UR5"}, selected="TUDelft-LAMA-UR5", Type=0)
load_robot_system = LoadRobotSystem(Name=robots_library, Base=PlaneXY(0, 0, 0))
robotsystem_parameter = RobotSystemParameter(load_robot_system)

# ---- group: base polygon surface
brep_2 = Brep(brep)

# ----
# define start point,
# point tool will start at
# prior to intializing print
number_slider_3 = Slider(0.525, range=0..1)
construct_point = ConstructPoint(XCoordinate=Slider(50, range=-400..500), YCoordinate=Slider(-399, range=-500..500), ZCoordinate=number_slider_3)

# ----
# define end point,
# point tool will return to
# after print is complete
number_slider_4 = Slider(50, range=-400..500)
construct_point_2 = ConstructPoint(XCoordinate=number_slider_4, YCoordinate=Slider(-399, range=-500..500), ZCoordinate=Slider(150, range=0..500))

# ----
# Define approach print path
# 
# Inputs:
# - TCP start point, length of approach path
# - TCP end point, length of return path
number_slider_5 = Slider(90, range=0..180)
xz_plane = XZPlane(Origin=construct_point)
xz_plane_2 = XZPlane(Origin=construct_point_2)
yz_plane = YZPlane(Origin=Point(0, 0, 0))
yz_plane_2 = YZPlane(Origin=Point(0, 0, 0))
rotate_3d = Rotate3D(Geometry=xz_plane, Angle=degrees(number_slider_5), Center=construct_point, Axis=yz_plane)  # -> Geometry, Transform
rotate_3d_2 = Rotate3D(Geometry=xz_plane_2, Angle=degrees(Slider(90, range=0..180)), Center=construct_point_2, Axis=yz_plane_2)  # -> Geometry, Transform
rotate_plane = RotatePlane(Plane=rotate_3d_2.Geometry, Angle=degrees("180"))
rotate_plane_2 = RotatePlane(Plane=rotate_3d.Geometry, Angle=degrees("180"))

# ----
# TCP start plane
plane = Plane(rotate_plane_2)

# ----
# TCP return plane
plane_2 = Plane(rotate_plane)

# ---- group: TCP approach plane
plane_start_end = Plane(plane)

# ---- group: TCP return plane
plane_3 = Plane(plane_2)

# ----
# Define robot parameters
# Inputs:
# - Robot speed
# - Zone
panel = Panel("""0
10""")
speed_mm_s = Slider(120, range=0..120)
speed_parameter = SpeedParameter(speed_mm_s)
zone_0 = ZoneParameter(panel)

# ----
# 1. DEFINE GEOMETRY
# 
# INPUT
# - polygon geometry
# (radius, number segments)
# - layer height
# - layer count
# - print width
# sliced geometry
layer_count = Slider(10, range=0..20)
num_layer_height = Number(layer_height)
num_layer_count = Number(layer_count)
num_layer_count_2 = Number(num_layer_count)
num_layer_height_2 = Number(num_layer_height)
series = Series(Start=0, Step=num_layer_height_2, Count=num_layer_count_2)
explode = Explode(Curve=polygon.Polygon, Recursive=True)  # -> graft(Segments), graft(Vertices)
unit_z = UnitZ(Factor=series)
value_list = ValueList({"OneLayer": 0, "AllLayers": 1}, selected="OneLayer")

# ---- group: move curves + z
move_curves = Move(Geometry=explode.Segments, Motion=unit_z)  # -> Geometry, Transform

# ---- group: move corner points + z
move = Move(Geometry=explode.Vertices, Motion=unit_z)  # -> Geometry, Transform

# ---- group: Polygon base curve
crv_layers = Curve(explode.Segments)

# ----
# extruded geometry
num_layer_height_3 = Number(num_layer_height)
num_layer_count_3 = Number(num_layer_count)
multiplication = Multiplication(A=num_layer_height_3, B=num_layer_count_3)
unit_z_2 = UnitZ(Factor=multiplication)
extrude = Extrude(Base=brep_2, Direction=unit_z_2)
brep_geometry = Brep(extrude)

# ----
# 2. ADJUST TCP BASED ON PRINT CONDITIONS
# 
# Inputs:
# - Measurements for clay extruder
# (global z and y offset)
# - Print board height
num_layer_height_4 = Number(num_layer_height)
addition = Addition(A=num_layer_height_4, B=global_z)
addition_2 = Addition(A=number_slider_2, B=addition)

# ----
# total height above table
# to clay extruder
addition_3 = Addition(A=number_slider, B=addition_2)

# ---- group: Construct Point
# point to define TCP approach plane
construct_point_3 = ConstructPoint(XCoordinate=addition_3, YCoordinate=global_x, ZCoordinate=global_y)

# ----
plane_4 = Plane(construct_point_3)

# ----
# plane rotations for tool
plane_5 = Plane(plane_4)
yz_plane_3 = YZPlane(Origin=Point(0, 0, 0))
rotate_3d_3 = Rotate3D(Geometry=plane_5, Angle=degrees(Slider(90, range=-180..180)), Center=plane_5, Axis=yz_plane_3)  # -> Geometry, Transform
xy_plane = XYPlane(Origin=Point(0, 0, 0))
rotate_3d_4 = Rotate3D(Geometry=rotate_3d_3.Geometry, Angle=degrees(Slider(90, range=-360..180)), Center=plane_5, Axis=xy_plane)  # -> Geometry, Transform
unit_x = UnitX(Factor=global_z)  # -> expr("-x", UnitVector)
rotate_plane_3 = RotatePlane(Plane=rotate_3d_4.Geometry, Angle=degrees(Slider(180, range=0..180)))
move_2 = Move(Geometry=rotate_plane_3, Motion=unit_x)  # -> Geometry, Transform

# ---- group: create tool representing clay extruder
plane_6 = Plane(rotate_plane_3)
cone = Cone(Base=move_2.Geometry, Radius="10", Length=global_z)  # -> Cone, Tip
create_tool = CreateTool(Name="Clay_extruder", TCP=plane_6, Weight="4.36", Mesh=cone.Cone)  # -> Tool, TCP
tool_parameter = ToolParameter(create_tool.Tool)
plane_7 = Plane(create_tool.TCP)

# ----
# visualize vectors for
# tool TCP plane
plane_8 = Plane(plane_7)
deconstruct_plane = DeconstructPlane(Plane=plane_8)  # -> Origin, XAxis, YAxis, ZAxis
amplitude = Amplitude(Vector=deconstruct_plane.XAxis, Amplitude="500")
amplitude_2 = Amplitude(Vector=deconstruct_plane.YAxis, Amplitude="500")
amplitude_3 = Amplitude(Vector=deconstruct_plane.ZAxis, Amplitude="500")
vector_display_ex = VectorDisplayEx(Point=deconstruct_plane.Origin, Vector=amplitude, Colour=ColourSwatch(SwatchColor=RGB(69, 0, 255)), Width="10")
vector_display_ex_2 = VectorDisplayEx(Point=deconstruct_plane.Origin, Vector=amplitude_2, Colour=ColourSwatch(SwatchColor=RGB(255, 0, 0)), Width="10")
vector_display_ex_3 = VectorDisplayEx(Point=deconstruct_plane.Origin, Vector=amplitude_3, Colour=ColourSwatch(SwatchColor=RGB(0, 169, 0)), Width="10")

flip_matrix = FlipMatrix(Data=move_curves.Geometry)
flip_matrix_2 = FlipMatrix(Data=move.Geometry)
corner_points = Point(flip_matrix_2)

# ---- group: Polygon curves above base
crv_layers_2 = Curve(flip_matrix)

# ----
stream_filter = StreamFilter(Gate=value_list, Stream0=crv_layers, Stream1=crv_layers_2)

# ---- group: Polygon curves
curve = Curve(stream_filter)

# ---- group: base polygon curve
crv_layers_3 = Curve(curve)

# ----
# 3. define TCP points at corner points of polygon
number_slider_6 = Slider(1, range=0..1)
divide_curve = DivideCurve(Curve=crv_layers_3, Count=number_slider_6, Kinks=False)  # -> flatten(Points), Tangents, Parameters
cull_duplicates = CullDuplicates(Points=divide_curve.Points, Tolerance=0.1, CullMode=3)  # -> Points, Indices, Valence

# ---- group: TCP planes for print geometry
plane_9 = Plane(cull_duplicates.Points)

# ----
# TCP plane rotations for print geometry
plane_10 = Plane(plane_9)
flip_plane = FlipPlane(Plane=plane_10, ReverseX=False, ReverseY=False, SwapAxes=True)
rotate_plane_4 = RotatePlane(Plane=flip_plane, Angle=degrees(Slider(-90, range=-180..180)))
plane_11 = Plane(rotate_plane_4)
list_item = ListItem(List=flatten(plane_11), Index=Slider(-3, range=-7..10), Wrap=True)
entwine = Entwine(Branch00=plane_11, Branch01=list_item, FlattenInputs=True)
plane_12 = Plane(entwine)

# ---- group: TCP geometry planes
plane_triangle_frames = Plane(flatten(plane_12))

# ----
# merge TCP geometry planes
# with start and return path planes
merge = Merge(Data1=plane_start_end, Data2=plane_triangle_frames, Data3=plane_3)  # -> flatten(Result)
plane_13 = Plane(merge)

# ---- group: planes for complete print path
plane_14 = Plane(plane_13)

# ----
# Set Robot target parameters
# Zone Input: this will control how the robot moves whene reaching a point/frame
# it can be helpfull especially for 3d printing because we can make the robot not just stop whene reaching a closed corner or smth similar
flag_fields = FlagFields({"Shoulder": 1, "Elbow": 2, "Wrist": 4}, selected=["Shoulder", "Wrist"])
value_list_2 = ValueList({"Joint", "Linear"}, selected="Linear")
tool_parameter_2 = ToolParameter(tool_parameter)
speed_parameter_2 = SpeedParameter(speed_parameter)
zone_0_2 = ZoneParameter(zone_0)
create_target = CreateTarget(
    Plane=plane_14,
    RobConf=flag_fields,
    Motion=value_list_2,
    Tool=tool_parameter_2,
    Speed=speed_parameter_2,
    Zone=zone_0_2,
    IsCartesian=True)  # -> flatten(Target)
target_parameter = TargetParameter(create_target)

# ----
# Create Robot program
robotsystem_parameter_2 = RobotSystemParameter(robotsystem_parameter)
target_parameter_2 = TargetParameter(target_parameter)
create_program = CreateProgram(Name="DefaultProgram", RobotSystem=robotsystem_parameter_2, Targets=target_parameter_2, StepSize=1)  # -> Program, Code, Duration, Warnings, Errors
panel_2 = Panel(create_program.Warnings)
program_parameter = ProgramParameter(create_program.Program)
text = Text(create_program.Code)

# ----
# UPLOAD PROGRAM
# 
# Inputs:
# - Boolean true to upload
# - Robot IP address
boolean_toggle = BooleanToggle(False)
program_parameter_2 = ProgramParameter(program_parameter)
ip = Panel("192.168.40.128")
remote_connection = RemoteConnection(Program=program_parameter_2, IP=ip, Upload=boolean_toggle, Play=Button(), Pause=Button())
panel_3 = Panel(remote_connection)

# ----
# SIMULATE PROGRAM
# 
# - play to visulaize robot path
colour_swatch = ColourSwatch(SwatchColor=RGB(97, 96, 95))
program_parameter_3 = ProgramParameter(program_parameter)
program_simulation = ProgramSimulation(Program=program_parameter_3, Time=Slider(1, range=0..1), Normalized=True)  # -> SystemMeshes, JointRotations, Plane, Index, Time, Program, Errors
simple_trail = SimpleTrail(Program=program_simulation.Program, Length=2000, MechanicalGroup=0)
custom_preview_2 = CustomPreview(Geometry=program_simulation.SystemMeshes, Material=colour_swatch)

# ---- group: UR script
text_2 = Text(text)

# ----
# OUTPUT UR SCRIPT TO A TXT FILE
# 
# Inputs:
# - file path to save txt file
extraction_script = Python3Script(x=text_2)  # -> out, a; inputs x: tree; disabled
# ---------- extraction_script: Python ----------
import ghpythonlib.treehelpers as ght

# Your existing code to get gcode_list
urscript_list = ght.tree_to_list(x)

# Recursive function to flatten the list completely
def flatten_list(nested_list):
    flat_list = []
    for item in nested_list:
        if isinstance(item, list) or isinstance(item, tuple):
            flat_list.extend(flatten_list(item))
        else:
            flat_list.append(item)
    return flat_list

# Flatten gcode_list completely
flat_gcode_list = flatten_list(urscript_list)

file_path = r"C:\Users\andre\Desktop\TU DELFT\Y2Q1\RoboPopsRepository_git\RoboAndreas\URscript.txt"
with open(file_path, "w") as file:
    for path in x.Paths:
        branch = x.Branch(path)
        for item in branch:
            file.write(str(item) + "\n")
        file.write("\n")
# ---------- end extraction_script ----------
